vi "index.gviweb"   [G Web Development Software 21.0.0]
panel controls:
  "ton email svp": string
panel indicators:
  "piéce nom conforme": f64
  "piéce conforme": f64
  "message": string
  "trop de piéce non conforme": bool
  "compteur de piéce non conforme": f64
  "vérification de l'email": string
  "piéce conforme": bool
  "probléme": string
  "nombre de piéce": string
uses:
  NI::Skyline::Configuration::Open Configuration API Key.gvi
  NI::Skyline::TagHTTP::Open Tag.gvi
  NI::Skyline::TagHTTP::Read Tag (String).gvi
  NI::Skyline::TagHTTP::Read Tag (DBL).gvi
  NI::Skyline::TagHTTP::Write Tag (String).gvi
diagram:
  call "Open Configuration API Key.gvi"(server url="https://api.systemlinkcloud.com", api key="gxAAP2a_oy9tBR3iEAWHeKbUXK9euMj5841Damu9zx") -> (configuration=w1, error out=w2)
  call "Open Tag.gvi"(path="piece", data type="String", error in=w2, configuration=w1) -> (tag=w3, error out=w4)
  call "Open Tag.gvi"(path="dhia07", data type="Double", error in=w2, configuration=w1) -> (tag=w5, error out=w6)
  call "Open Tag.gvi"(path="problem", data type="String", error in=w2, configuration=w1) -> (tag=w7, error out=w8)
  call "Open Tag.gvi"(path="dhaoui", data type="Double", error in=w2, configuration=w1) -> (tag=w9, error out=w10)
  call "Open Tag.gvi"(path="markage.lisertest", data type="Double", error in=w2, configuration=w1) -> (tag=w11, error out=w12)
  call "Open Tag.gvi"(path="dridi", data type="String", error in=w2, configuration=w1) -> (tag=w13, error out=w14)
  while {
    call "Read Tag (String).gvi"(tag in=w3, error in=w4) -> (value=w15)
    $"nombre de piéce" <- w15
    call "Read Tag (DBL).gvi"(tag in=w5, error in=w6) -> (value=w16)
    call "Read Tag (String).gvi"(tag in=w7, error in=w8) -> (value=w17)
    Is Equal(x=w17, y="aucune probléme") -> w18
    case (w18) {
      frame False, Default {
        w19 = w16
      }
      frame True {
        Increment(x=w16) -> w19
      }
    }
    $"piéce conforme" <- w19
    $probléme <- w17
    call "Read Tag (DBL).gvi"(tag in=w9, error in=w10) -> (value=w20)
    Is Equal(x=4, y=w20) -> w21
    case (w21) {
      frame False, Default {
        w22 = FALSE
        w23 = TRUE
      }
      frame True {
        w22 = TRUE
        w23 = FALSE
      }
    }
    $"piéce conforme" <- w23
    $"trop de piéce non conforme" <- w22
    call "Read Tag (DBL).gvi"(tag in=w11, error in=w12) -> (value=w24)
    Is Not Equal(x=w17, y="aucune probléme") -> w25
    case (w25) {
      frame False, Default {
        w26 = w20
        w27 = w24
      }
      frame True {
        Increment(x=w20) -> w26
        Increment(x=w24) -> w27
      }
    }
    $"compteur de piéce non conforme" <- w26
    Is Greater Or Equal(x=w27, y=4) -> w28
    Logical Or(w21, w28) -> w29
    case (w29) {
      frame False, Default {
        w30 = "mercis d'avoir visualiser le marquage "
      }
      frame True {
        w31 = "attention vous avez troup de piéce non conforme svp régler la panne "
        w30 = w31
      }
    }
    $message <- w30
    call "Read Tag (String).gvi"(tag in=w13, error in=w14) -> (value=w32)
    $"vérification de l'email" <- w32
    $"piéce nom conforme" <- w27
    call "Write Tag (String).gvi"(tag in=w13, value=$"ton email svp", error in=w14)
    stop if FALSE
  }
